# Grasshopper definition gh_node_extractor.gh (Grasshopper 1.0.4)

geo = Geometry(<brep referenced from the Rhino model>)
geo_2 = Geometry([<point referenced from the Rhino model> x97])
geo_3 = Geometry([<point referenced from the Rhino model> x98])
geo_4 = Geometry([<curve referenced from the Rhino model> x435])
srf_cp = SurfaceClosestPoint(Point=geo_2, Surface=geo)  # -> Point, UVPoint, Distance
crv = Curve([<curve referenced from the Rhino model> x816])
geo_5 = Geometry([<point referenced from the Rhino model> x8])
geo_6 = Geometry([<point referenced from the Rhino model> x28])
geo_7 = Geometry([<curve referenced from the Rhino model> x100])
evalsrf = EvaluateSurface(Surface=geo, Point=srf_cp.UVPoint)  # -> Point, Normal, Frame
end = EndPoints(Curve=geo_7)  # -> Start, End
multiplication = Multiplication(A=evalsrf.Normal, B=100)
end_2 = EndPoints(Curve=geo_4)  # -> Start, End
end_3 = EndPoints(Curve=crv)  # -> Start, End
cullpt = CullDuplicates(Points=geo_5, Tolerance=0.1, CullMode=3)  # -> Points, Indices, Valence
cullpt_2 = CullDuplicates(Points=geo_6, Tolerance=0.1, CullMode=3)  # -> Points, Indices, Valence
merge = Merge(Data1=end.Start, Data2=end.End)  # -> flatten(Result)
move = Move(Geometry=evalsrf.Point, Motion=multiplication)  # -> Geometry, Transform
merge_2 = Merge(Data1=end_3.Start, Data2=end_3.End)  # -> flatten(Result)
merge_3 = Merge(Data1=end_2.Start, Data2=end_2.End)  # -> flatten(Result)
cullpt_3 = CullDuplicates(Points=merge_2, Tolerance=0.1, CullMode=3)  # -> Points, Indices, Valence
larger = LargerThan(FirstNumber=cullpt_3.Valence, SecondNumber=6)  # -> LargerThan, OrEqualTo
cp = ClosestPoint(Point=cullpt.Points, Cloud=cullpt_3.Points)  # -> ClosestPoint, CPIndex, Distance
cp_2 = ClosestPoint(Point=end_3.End, Cloud=cullpt_3.Points)  # -> ClosestPoint, CPIndex, Distance
cp_3 = ClosestPoint(Point=end_3.Start, Cloud=cullpt_3.Points)  # -> ClosestPoint, CPIndex, Distance
cp_4 = ClosestPoint(Point=merge, Cloud=cullpt_3.Points)  # -> ClosestPoint, CPIndex, Distance
cullpt_4 = CullDuplicates(Points=merge_3, Tolerance=0.1, CullMode=3)  # -> Points, Indices, Valence
cp_5 = ClosestPoint(Point=evalsrf.Point, Cloud=cullpt_4.Points)  # -> ClosestPoint, CPIndex, Distance
entwine = Entwine(Branch00=cp_5.CPIndex, Branch01=evalsrf.Normal, FlattenInputs=True)
flip = FlipMatrix(Data=entwine)
cp_6 = ClosestPoint(Point=end_2.End, Cloud=cullpt_4.Points)  # -> ClosestPoint, CPIndex, Distance
cp_7 = ClosestPoint(Point=end_2.Start, Cloud=cullpt_4.Points)  # -> ClosestPoint, CPIndex, Distance
cp_8 = ClosestPoint(Point=cullpt_2.Points, Cloud=cullpt_3.Points)  # -> ClosestPoint, CPIndex, Distance
vec2pt = Vector2Pt(PointA=end.Start, PointB=end.End, Unitize=True)  # -> Vector, Length
dispatch = Dispatch(List=cullpt_3.Points, DispatchPattern=larger.OrEqualTo)  # -> ListA, ListB
Z = UnitZ(Factor=-1)
entwine_2 = Entwine(Branch00=cp_3.CPIndex, Branch01=cp_2.CPIndex, FlattenInputs=True)
smaller = SmallerThan(FirstNumber=cp_4.Distance, SecondNumber=1)  # -> SmallerThan, OrEqualTo
entwine_3 = Entwine(Branch00=cp_7.CPIndex, Branch01=cp_6.CPIndex, FlattenInputs=True)
pt = Point(dispatch.ListA)
panel = Panel(cullpt_3.Points)
dispatch_2 = Dispatch(List=cp_4.CPIndex, DispatchPattern=smaller.SmallerThan)  # -> ListA, ListB
crossref = CrossReference(ListA=Z, ListB=cp_8.CPIndex, CrossMode=1)  # -> ListA, ListB
flip_2 = FlipMatrix(Data=entwine_2)
panel_2 = Panel(flip)
panel_3 = Panel(cullpt_4.Points)
flip_3 = FlipMatrix(Data=entwine_3)
entwine_4 = Entwine(Branch00=crossref.ListA, Branch01=crossref.ListB, FlattenInputs=True)
graft = GraftTree(Tree=entwine_4, IncludeEmptyLists=True, IncludeNullItems=True)
num2pt = NumbersToPoints(Numbers=flatten(flip_2), Mask=2)
entwine_5 = Entwine(Branch00=vec2pt.Vector, Branch01=dispatch_2.ListA, FlattenInputs=True)
merge_4 = Merge(Data1=Z, Data2=cp_8.CPIndex)
num2pt_2 = NumbersToPoints(Numbers=flatten(flip_3), Mask=2)
flip_4 = FlipMatrix(Data=entwine_4)
panel_4 = Panel(cp.CPIndex)
panel_5 = Panel(num2pt)
flip_5 = FlipMatrix(Data=entwine_5)
panel_6 = Panel(num2pt_2)
panel_7 = Panel(flip_4)
panel_8 = Panel(flip_5)
